# Grasshopper definition DynamicGradients.gh (Grasshopper 0.9.76)

swatch = Blue(SwatchColor=RGB(0, 128, 255))
swatch_2 = Yellow(SwatchColor=RGB(255, 225, 0))
swatch_3 = Green(SwatchColor=RGB(0, 205, 0))
swatch_4 = Red(SwatchColor=RGB(255, 0, 0))
swatch_5 = Blue(SwatchColor=RGB(0, 128, 255))
weights = GenePool(Decimals=2, Maximum=1, Minimum=0, Value=[0, 0.11, 0.29, 1])
swatch_6 = Yellow(SwatchColor=RGB(255, 225, 0))
swatch_7 = Green(SwatchColor=RGB(0, 205, 0))
swatch_8 = Red(SwatchColor=RGB(255, 0, 0))
merge = Merge(Data1=swatch_4, Data2=swatch_2, Data3=swatch_3, Data4=swatch)
range = Range(Domain=Domain(0, 1), Steps="20")
merge_2 = Merge(Data1=swatch_8, Data2=swatch_6, Data3=swatch_7, Data4=swatch_5)
range_2 = Range(Domain=Domain(0, 1), Steps="20")
consec = ConsecutiveDomains(Numbers=weights, Additive="False")
fdom = FindDomain(Domains=consec, Number=range_2, Strict=False)  # -> Index, Neighbour
interp = InterpolateData(Data=merge, Parameter=range, Interpolation=2)
item = ListItem(List=consec, Index=fdom.Index, Wrap=True)
item_2 = ListItem(List=merge_2, Index=fdom.Index, Wrap=True)  # -> graft(Item), graft(Item1)
remap = RemapNumbers(Value=range_2, Source=item, Target=Domain(0, 1))  # -> graft(Mapped), Clipped
merge_3 = Merge(Data1=item_2.Item, Data2=item_2.Item1)
interp_2 = InterpolateData(Data=merge_3, Parameter=remap.Mapped, Interpolation=2)  # -> flatten(Value)
legend = Legend(Colour=interp, Tags=range, LegendType=101)
legend_2 = Legend(Colour=interp_2, Tags=range_2, LegendType=101)
