# Grasshopper definition mixed1.gh (Grasshopper 0.9.75)
# plug-ins: Squid

panel = Panel("""На чем можно сэкономить при устройстве теплой кровли?
Част 1: Как прокормить Щенка
Часть 2: Как избавиться от собаки
Любовь""")
paid = BooleanToggle(False)
open = BooleanToggle(False)
item = ListItem(List=panel, Index=Slider(1, range=0..10), Wrap=True)

# ---- group: DataPanel
duration = Integer("115")
name = Text(item)
type = Text("hozyaystvo")
days = Integer(Slider(28, range=0..100))
paid_2 = Boolean(paid)
uid = Integer("5634")

# ----
open_2 = Boolean(open)
tag = Integer(Slider(2, range=0..2))
remap = RemapNumbers(Value=days, Source=Domain(0, 30), Target=Domain(0, 1))  # -> Mapped, Clipped
remap_2 = RemapNumbers(Value=duration, Source=Domain(0, 180), Target=Domain(0, 1))  # -> Mapped, Clipped
cluster = Cluster_4(T=name, B=uid)
concat = Concatenate(FragmentA="duration_", FragmentB=duration)
panel_2 = Panel("""hozyaystvo
business
design
finance
psicology""")
panel_3 = Panel("""1
2
3
4
5""")
keysearch = KeyValueSearch(Keys=panel_2, Values=panel_3, Search=type)
rectpointoffset = Slider(60, range=0..100)
angle_seed = Slider(57, range=0..100)
circlesnum = Slider(400, range=0..1000)
cpoint_seed = Slider(74, range=0..100)
rad_seed = Slider(89, range=0..100)
color_seed = Slider(52, range=0..100)

# ---- group: Canvas
id = Guid(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)
rec = Rectangle(id)

# ----
neg = Negative(Value=rectpointoffset)
offset = Offset(Curve=rec, Distance=neg, Plane=PlaneXY(0, 0, 0), Corners=1)
number_slider = Slider(14, range=0..30)
number_slider_2 = Slider(310, range=180..350)

# ---- group: CenterPoint
pop2d = Populate2D(Region=offset, Count=1, Seed=cpoint_seed)
pt = Point(pop2d)

# ----
remap_3 = RemapNumbers(Value=number_slider_2, Source=Domain(180, 350), Target=Domain(30, 110))  # -> Mapped, Clipped
multiplication = Multiplication(A=remap_3.Mapped, B=remap_2.Clipped)
cluster_2 = Cluster_2(base=number_slider_2, delta=multiplication)
random = Random(Range=Domain(0, 200), Number=circlesnum, Seed=angle_seed)
pt_2 = Point(pt)

num = Number(cluster)
addition = Addition(A=Slider(0, range=0..1), B=num)

num_2 = Number(Slider(0.2, range=0..1))

# ---- group: BaseColor
cluster_3 = Cluster_2(base=num_2, delta=Slider(0.137, range=0..0.5))
domaintocolorshsv = DomainToColorsHSV(I=cluster_3)
legend = Legend(Colour=domaintocolorshsv, Tags=["Low", "Center", "Hight"], LegendType=1)

# ----
multiplication_2 = Multiplication(A=num_2, B=100)
int = Integer(multiplication_2)

number_slider_3 = Slider(47, range=0..1000)  # disabled
number_slider_4 = Slider(100, range=0..1000)  # disabled
number_slider_5 = Slider(100, range=0..1000)  # disabled
c_script = CSharpScript(h=number_slider_3, S=number_slider_4, V=number_slider_5)  # -> out, r, g, b; inputs h: Double, S: Double, V: Double; disabled
# ---------- c_script: C# ----------
    double H = h;

    while (H < 0) { H += 360; };
    while (H >= 360) { H -= 360; };
    double R, G, B;
    if (V <= 0)
    { R = G = B = 0; }
    else if (S <= 0)
    {
      R = G = B = V;
    }
    else
    {
      double hf = H / 60.0;
      int i = (int) Math.Floor(hf);
      double f = hf - i;
      double pv = V * (1 - S);
      double qv = V * (1 - S * f);
      double tv = V * (1 - S * (1 - f));
      switch (i)
      {

        // Red is the dominant color

        case 0:
          R = V;
          G = tv;
          B = pv;
          break;

        // Green is the dominant color

        case 1:
          R = qv;
          G = V;
          B = pv;
          break;
        case 2:
          R = pv;
          G = V;
          B = tv;
          break;

        // Blue is the dominant color

        case 3:
          R = pv;
          G = qv;
          B = V;
          break;
        case 4:
          R = tv;
          G = pv;
          B = V;
          break;

        // Red is the dominant color

        case 5:
          R = V;
          G = pv;
          B = qv;
          break;

        // Just in case we overshoot on our math by a little, we put these here. Since its a switch it won't slow us down at all to put these here.

        case 6:
          R = V;
          G = tv;
          B = pv;
          break;
        case -1:
          R = V;
          G = pv;
          B = qv;
          break;

        // The color is not defined, we should throw an error.

        default:
          //LFATAL("i Value error in Pixel conversion, Value is %d", i);
          R = G = B = V; // Just pretend its black/white
          break;
      }
    }
    R = R * 255.0;
    G = G * 255.0;
    B = B * 255.0;

    if(R > 255.0){R = 255.0;}
    if(G > 255.0){G = 255.0;}
    if(B > 255.0){B = 255.0;}

    if(R < 0){R = 0.0;}
    if(G < 0){G = 0.0;}
    if(B < 0){B = 0.0;}

    r = R;
    g = G;
    b = B;
# ---------- end c_script ----------
remap_4 = RemapNumbers(Value=c_script.r, Source=Domain(0, 255), Target=Domain(0, 1))  # -> Mapped, Clipped; disabled
remap_5 = RemapNumbers(Value=c_script.g, Source=Domain(0, 255), Target=Domain(0, 1))  # -> Mapped, Clipped; disabled
remap_6 = RemapNumbers(Value=c_script.b, Source=Domain(0, 255), Target=Domain(0, 1))  # -> Mapped, Clipped; disabled
rgb = ColourRGB(Alpha=255, Red=remap_4.Mapped, Green=remap_5.Mapped, Blue=remap_6.Mapped)  # disabled
legend_2 = Legend(Colour=rgb, Tags="One Fish", LegendType=1)  # disabled

int_2 = Integer(tag)
txt = Text(concat)

# ---- group: background
background = ColourSwatch(SwatchColor=RGB(0, 0, 0))
clear = Clear(Color=background)

# ----
int_3 = Integer(circlesnum)
c_script_2 = CSharpScript(
    mean=0,
    std=1,
    N=int_3,
    seed=rad_seed,
    TooltipDescriptionOverride="using Box-Multer transformation",
    TooltipTextOverride="Gassian Random")  # -> out, A; inputs mean: Double, std: Double, N: Int32, seed: Int32
# ---------- c_script_2: C# ----------
    Random rand = new Random(seed);
    double[] rArray = new double[N];

    for (int i = 0; i < N; i++){

      double u1 = rand.NextDouble();
      double u2 = rand.NextDouble();

      double randStdNormal = Math.Sqrt(-2.0 * Math.Log(u1)) * Math.Sin(2.0 * Math.PI * u2);

      rArray[i] = mean + std * randStdNormal;
    }
    A = rArray;
# ---------- end c_script_2 ----------
multiplication_3 = Multiplication(A=c_script_2.A, B=Slider(16, range=0..40))
remap_7 = RemapNumbers(Value=multiplication_3, Source=Domain(0, 30), Target=Domain(5, 80))  # -> Mapped, Clipped
remap_8 = RemapNumbers(Value=remap_7.Mapped, Source=Domain(0, 150), Target=Domain(400, 0))  # -> Mapped, Clipped
cluster_4 = Cluster_3(num=Slider(12, range=0..100))
lng = ListLength(List=remap_8.Mapped)
random_2 = Random(Range=cluster_4, Number=lng, Seed=2)

remap_9 = RemapNumbers(Value=remap_8.Mapped, Source=Domain(300, 500), Target=cluster_2)  # -> Mapped, Clipped

addition_2 = Addition(A=random_2, B=remap_9.Mapped)

# ---- group: if
num_3 = Number(random)
num_4 = Number(addition_2)

# ----
pt_3 = PointCylindrical(BasePlane=pt, Angle=num_3, Radius=num_4, Elevation=0)
pt_4 = Point(pt_3)

pt_5 = Point(pt_4)
pt_6 = Point(pt_2)

vec2pt = Vector2Pt(PointA=pt_6, PointB=pt_5, Unitize=False)  # -> Vector, Length
sort = SortList(Keys=vec2pt.Length, ValuesA=vec2pt.Vector, ValuesB=pt_5)  # -> Keys, ValuesA, ValuesB
num_5 = Number(sort.Keys)
vec = Vector(sort.ValuesA)
pt_7 = Point(sort.ValuesB)

# ---- group: Base vector
Z = UnitZ(Factor=1)
Y = UnitY(Factor=1)
pi = Pi(Factor=Slider(0.79, range=0..2))
vrot = Rotate(Vector=Y, Axis=Z, Angle=pi)
vdis = VectorDisplay(Anchor=pt_6, Vector=vrot)

# ----
num_6 = Number(num_5)
lng_2 = ListLength(List=num_6)
subtraction = Subtraction(A=lng_2, B=2)

# ---- group: angle_mulyplier
angle = Angle(VectorA=vrot, VectorB=vec)  # -> Angle, Reflex
number_slider_6 = Slider(0.02, range=0..1.5)
num_7 = Number(angle.Angle)
eval = Evaluate(F="if(x≤Pi,x-0.5*Pi,1.5*Pi-x)", x=num_7)
bnd = Bounds(Numbers=eval)
larger = LargerThan(FirstNumber=num_6, SecondNumber=Slider(149, range=0..800))  # -> LargerThan, OrEqualTo
neg_2 = Negative(Value=number_slider_6)
smaller = SmallerThan(FirstNumber=eval, SecondNumber=neg_2)  # -> SmallerThan, OrEqualTo
larger_2 = LargerThan(FirstNumber=eval, SecondNumber=number_slider_6)  # -> LargerThan, OrEqualTo
and = GateAnd(A=larger_2.LargerThan, B=larger.LargerThan)
and_2 = GateAnd(A=smaller.SmallerThan, B=larger.LargerThan)

# ----
range = Range(Domain=Domain(0, 1), Steps=subtraction)
remap_10 = RemapNumbers(Value=range, Source=Domain(0, 1), Target=cluster_3)  # -> Mapped, Clipped
pie = PieChart(smaller.SmallerThan)
pie_2 = PieChart(larger.LargerThan)

dom = ConstructDomain(DomainStart=Slider(0.335, range=0..1), DomainEnd=Slider(0.842, range=0..1))
num_8 = Number(remap_10.Mapped)
multchosenbyrandom = MultChosenByRandom(num=num_8, bool=and, R=dom, S=color_seed)  # -> num_4, W
num_9 = Number(num_6)
cube = Cube(Value=num_9)
dom_2 = ConstructDomain(DomainStart=Slider(1, range=1..2), DomainEnd=Slider(1.309, range=1..2))
num_10 = Number(num_9)
multchosenbyrandom_2 = MultChosenByRandom(num=multchosenbyrandom.num_4, bool=and_2, R=dom_2, S=color_seed)  # -> num_4, W
dom_3 = ConstructDomain(DomainStart=Slider(-70, range=-100..100), DomainEnd=Slider(60, range=0..100))
multiplication_4 = Multiplication(A=multchosenbyrandom_2.W, B=multchosenbyrandom.W)
num_11 = Number(multchosenbyrandom_2.num_4)
remap_11 = RemapNumbers(Value=num_10, Source="1200 to 0", Target=dom_3)  # -> Mapped, Clipped
eval_2 = Evaluate(F="if(x>1,x-Floor(x),if(x<0,x-Floor(x),x))", x=num_11)
multiplication_5 = Multiplication(A=multiplication_4, B=remap_11.Mapped)
hsl = ColourHSL(Alpha=1, Hue=eval_2, Saturation=1, Luminance=0.5)
num_12 = Number(multiplication_5)
bar_graph = BarGraph(num_12, BarColor=RGB(255, 0, 90))

col = Colour(hsl)
num_13 = Number(num_12)

pt_8 = Point(pt_7)

seed = Panel("2")
jitter = Jitter(List=col, Jitter=1, Seed=seed)  # -> Values, Indices
jitter_2 = Jitter(List=pt_8, Jitter=1, Seed=seed)  # -> Values, Indices
jitter_3 = Jitter(List=num_13, Jitter=1, Seed=seed)  # -> Values, Indices
lng_3 = ListLength(List=jitter.Values)
multiplication_6 = Multiplication(A=Slider(0.63, range=0..1), B=lng_3)
int_4 = Integer(multiplication_6)
split = SplitList(List=jitter_2.Values, Index=int_4)  # -> ListA, ListB
split_2 = SplitList(List=jitter_3.Values, Index=int_4)  # -> ListA, ListB

pln = Plane(pt_8)
num_14 = Number(num_13)
pln_2 = Plane(pln)

# ---- group: ortogonal
cluster_5 = Cluster_5(B=pln_2)

# ----
cluster_6 = Cluster_5(B=split.ListA)
num_15 = Number(split_2.ListA)

filletradius = Slider(0.15, range=0..1)
pln_3 = Plane(cluster_6)
multiplication_7 = Multiplication(A=num_15, B=filletradius)
polygon = Polygon(Plane=pln_3, Radius=num_15, Segments=3, FilletRadius=multiplication_7)  # -> Polygon, Length

num_16 = Number(split_2.ListB)
pln_4 = Plane(split.ListB)
cir = Circle(Plane=pln_4, Radius=num_16)

crv = Curve(polygon.Polygon)
crv_2 = Curve(cir)
merge = Merge(Data1=crv, Data2=crv_2)
num_17 = Number(jitter_3.Values)

bool = Boolean(open_2)

gate = StreamGate(Stream=cluster_5, Gate=bool)  # -> Target0, Target1

rotate45 = Rotate45(pln=gate.Target1)
filter = StreamFilter(Gate=bool, Stream0=gate.Target0, Stream1=rotate45)

pln_5 = Plane(cluster_6)
num_18 = Number(split_2.ListA)

multiplication_8 = Multiplication(A=num_18, B=Slider(2.53, range=0..10))

cluster_7 = Cluster(num=multiplication_8, B=Slider(0.22, range=0..1))  # -> num_3, R
rectangle = Rectangle(Plane=pln_5, XSize=cluster_7.num_3, YSize=cluster_7.R, Radius=1000)  # -> Rectangle, Length

crv_3 = Curve(rectangle.Rectangle)

list = ValueList({"Lines": 0, "Triangles": 1, "Circles": 2}, selected="Circles")
filter_2 = StreamFilter(Gate=int_2, Stream0=crv_3, Stream1=crv, Stream2=crv_2)
col_2 = Colour(jitter.Values)
list_2 = ValueList({"Circle": "1_circle_", "Triangular": "2_triangular_", "Line": "3_line_"}, selected="Line")
digit_scroller = DigitScroller(Scroller_Digits=12, Scroller_Prefix="Fragment B", Scroller_Radix=11, Scroller_Value=17)
background_2 = ColourSwatch(SwatchColor=RGB(0, 0, 0))
panel_4 = Panel("""1_circle_
2_triangular_
3_line_""")
panel_5 = Panel("""0
1
2""")
outline = Outline(Color=background_2, Width=Slider(2, range=0..10))
panel_6 = Panel("C:\Users\Филипп\Desktop\Generative_patters\imgs\sketch2\distr")
concat_2 = Concatenate(FragmentA=list_2, FragmentB=digit_scroller)
keysearch_2 = KeyValueSearch(Keys=panel_4, Values=panel_5, Search=list_2)
save = Save(Folder=panel_6, Filename="experiment4", Tiff=False)  # -> SquidInstr, Path; disabled
filter_3 = StreamFilter(Gate=keysearch_2)
rec_2 = Rectangle(rec)

sort_2 = SortList(Keys=num_17, ValuesA=merge, ValuesB=col_2)  # -> Keys, ValuesA, ValuesB

crv_4 = Curve(sort_2.ValuesA)
draw = Draw(Curve=crv_4, Accuracy=-1, Fill=sort_2.ValuesB)  # -> SquidInstr, Curve
merge_2 = Merge(Data1=flatten(clear), Data2=flatten(draw.SquidInstr), Data3=flatten(save.SquidInstr))
squid = Squid(BitmapR=rec_2, SquidInstr=merge_2, PPU=1, AA=True, autohide=False)

# ==== cluster Cluster
num = ClusterInput()
num_2 = Number(num)
B = ClusterInput()
multiplication = Multiplication(A=num_2, B=B)
R = ClusterOutput(multiplication)
num_3 = ClusterOutput(num_2)

# ==== cluster Rotate45
pln = ClusterInput()
pln_2 = Plane(pln)
rotate = Rotate(Geometry=pln_2, Angle=0.7853981634, Plane=pln_2)  # -> Geometry, Transform
pln_3 = Plane(rotate.Geometry)
pln_4 = ClusterOutput(pln_3)

# ==== cluster Cluster_2
base = ClusterInput()
delta = ClusterInput()
subtraction = Subtraction(A=base, B=delta)
addition = Addition(A=base, B=delta)
dom = ConstructDomain(DomainStart=subtraction, DomainEnd=addition)
I = ClusterOutput(dom)

# ==== cluster DomainToColorsHSV
I = ClusterInput()
dedomain = DeconstructDomain(Domain=I)  # -> Start, End
avr = Average(Input=[dedomain.Start, dedomain.End])
merge = Merge(Data1=dedomain.Start, Data2=avr, Data3=dedomain.End)
eval = Evaluate(F="if(x>1,x-Floor(x),if(x<0,x-Floor(x),x))", x=merge)
hsl = ColourHSL(Alpha=1, Hue=eval, Saturation=1, Luminance=0.5)
C = ClusterOutput(hsl)

# ==== cluster MultChosenByRandom
num = ClusterInput()
S = ClusterInput()
R = ClusterInput()
bool = ClusterInput()
bool_2 = Boolean(bool)
num_2 = Number(num)
not = GateNot(A=bool_2)
ma = MassAddition(Input=not)  # -> Result, PartialResults
ma_2 = MassAddition(Input=bool_2)  # -> Result, PartialResults
random = Random(Range=R, Number=ma_2.Result, Seed=S)
repeat = RepeatData(Data=1, Length=ma.Result)
weave = Weave(Pattern=bool_2, Stream0=repeat, Stream1=random, NullGaps=False)
multiplication = Multiplication(A=num_2, B=weave)
num_3 = Number(multiplication)
W = ClusterOutput(weave)
num_4 = ClusterOutput(num_3)

# ==== cluster Cluster_3
num = ClusterInput()
num_2 = Number(num)
neg = Negative(Value=num_2)
dom = ConstructDomain(DomainStart=neg, DomainEnd=num_2)
I = ClusterOutput(dom)

# ==== cluster Cluster_4
T = ClusterInput()
B = ClusterInput()

len = TextLength(Text=T)
multiplication = Multiplication(A=len, B=B)

int = Integer(60)
mod = Modulus(A=multiplication, B=int)
remap = RemapNumbers(Value=mod, Source=int, Target=Domain(0, 1))  # -> Mapped, Clipped
num = Number(remap.Mapped)

num_2 = ClusterOutput(num)

# ==== cluster Cluster_5
range = Range(Domain=Domain(0, 6.283185307), Steps=4)
jitter = Jitter(List=range, Jitter=1, Seed=2)  # -> Values, Indices
B = ClusterInput()
long = LongestList(ListA=jitter.Values, ListB=B, PaddingMode=4)  # -> ListA, ListB
prot = RotatePlane(Plane=B, Angle=long.ListA)
P = ClusterOutput(prot)
