# Grasshopper definition sketch1.gh (Grasshopper 0.9.75)
# plug-ins: Squid

rectpointoffset = Slider(99, range=0..100)
cpoint_seed = Slider(18, range=0..100)
circlesnum = Slider(186, range=0..300)

# ---- group: Canvas
id = Guid(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)
rec = Rectangle(id)

# ----
neg = Negative(Value=rectpointoffset)
offset = Offset(Curve=rec, Distance=neg, Plane=PlaneXY(0, 0, 0), Corners=1)
angle_seed = Slider(76, range=0..100)
rad_seed = Slider(27, range=0..100)

# ---- group: DistanceDistr
dom = ConstructDomain(DomainStart=Slider(40, range=0..200), DomainEnd=Slider(1153, range=0..1500))
random = Random(Range=dom, Number=circlesnum, Seed=rad_seed)
cluster = Cluster(num=random, bool=Toggle(True))  # -> R, i
domain = Domain(dom)
graph = GraphMapper(
    cluster.R,
    x0=0,
    x1=1,
    y0=0,
    y1=1,
    container_name="Bezier",
    cpx=[0, 0.3516674936, 0.6226668358, 1],
    cpy=[0, 0.1340575218, 0.5231884718, 1])
remap = RemapNumbers(Value=graph, Source=Domain(0, 1), Target=domain)  # -> Mapped, Clipped

# ---- group: CenterPoint
pop2d = Populate2D(Region=offset, Count=1, Seed=cpoint_seed)
pt = Point(pop2d)

# ----
random_2 = Random(Range=Domain(0, 200), Number=circlesnum, Seed=angle_seed)
pt_2 = PointCylindrical(BasePlane=pt, Angle=random_2, Radius=remap.Mapped, Elevation=0)

# ---- group: Circles Radiuses
pt_3 = Point(pt_2)
pt_4 = Point(pt)
dist = Distance(PointA=pt_3, PointB=pt_4)
cluster_2 = Cluster(num=dist, bool=True)  # -> R, i
base_mult = Slider(15.8, range=0..100)
random_mult = Slider(2, range=1..2)
graph_2 = GraphMapper(
    cluster_2.R,
    x0=0,
    x1=1,
    y0=0,
    y1=1,
    container_name="Bezier",
    cpx=[0, 0.1073626056, 0, 1],
    cpy=[1, 0.7394201159, 0.07530409098, 0.02707219124])
dom_2 = ConstructDomain(DomainStart=1, DomainEnd=random_mult)
multiplication = Multiplication(A=graph_2, B=base_mult)
random_3 = Random(Range=dom_2, Number=circlesnum, Seed=2)
multiplication_2 = Multiplication(A=multiplication, B=random_3)

# ----
sort = SortList(Keys=dist)  # -> Keys, ValuesA

num = Number(sort.Keys)
bnd = Bounds(Numbers=num)
remap_2 = RemapNumbers(Value=num, Source=bnd, Target=Domain(0, 1))  # -> Mapped, Clipped

graph_3 = GraphMapper(
    remap_2.Mapped,
    x0=0,
    x1=1,
    y0=0,
    y1=1,
    container_name="Bezier",
    cpx=[0, 0.6684800386, 1, 1],
    cpy=[0, 0.1467382312, 0.3134049177, 1])
far = ColourSwatch(SwatchColor=RGBA(74, 0, 247, 160))
close = ColourSwatch(SwatchColor=RGB(255, 0, 0))
range = Range(Domain=Domain(0, 1), Steps=10)
pgradient = Cluster_2(col=far, col_2=close, num=graph_3)
cluster_3 = Cluster_2(col=far, col_2=close, num=range)
legend = Legend(Colour=cluster_3, Tags=range, LegendType=101)
cir = Circle(Plane=pt_2, Radius=multiplication_2)

# ---- group: sort circle by radius
sort_2 = SortList(Keys=cir, ValuesA=cir)  # -> Keys, ValuesA

# ----
digit_scroller = DigitScroller(Scroller_Digits=12, Scroller_Prefix="Fragment B", Scroller_Radix=11, Scroller_Value=8)
list = ValueList({"Circle": "circle_", "Triangular": "triangular_", "Line": "line"_}, selected="Circle")
concat = Concatenate(FragmentA=list, FragmentB=digit_scroller)
draw = Draw(Curve=sort_2.ValuesA, Accuracy=-1, Fill=pgradient)  # -> SquidInstr, Curve

# ---- group: background
background = ColourSwatch(SwatchColor=RGB(49, 7, 61))
clear = Clear(Color=background)

# ----
save = Save(Folder="C:\Users\Филипп\Desktop\Generative_patters\imgs\sketch1", Filename=concat, Tiff=False)  # -> SquidInstr, Path; disabled
merge = Merge(Data1=flatten(clear), Data2=flatten(draw.SquidInstr), Data3=flatten(save.SquidInstr))
squid = Squid(BitmapR=rec, SquidInstr=merge, PPU=1, AA=True, autohide=False)
qpreview = QuickPreview(Bitmap=squid)

# ==== cluster Cluster
bool = ClusterInput()
num = ClusterInput()
bool_2 = Boolean(bool)
int = Integer(0)

num_2 = Number(num)
sort = SortList(Keys=num_2)  # -> Keys, ValuesA
item = ListItem(List=sort.Keys, Index=0, Wrap=True)

filter = StreamFilter(Gate=bool_2, Stream0=int, Stream1=item)
item_2 = ListItem(List=sort.Keys, Index=-1, Wrap=True)
dom = ConstructDomain(DomainStart=filter, DomainEnd=item_2)

remap = RemapNumbers(Value=num_2, Source=dom, Target=Domain(0, 1))  # -> Mapped, Clipped

i = ClusterOutput(item_2)
R = ClusterOutput(remap.Mapped)

# ==== cluster Cluster_2
col = ClusterInput()
col_2 = ClusterInput()
num = ClusterInput()
col_3 = Colour(col)
col_4 = Colour(col_2)
num_2 = Number(graft(num))
subtraction = Subtraction(A=1, B=num_2)
merge = Merge(Data1=subtraction, Data2=num_2)
wav = WeightedAverage(Input=[col_3, col_4], Weights=merge)  # -> flatten(ArithmeticMean)
am = ClusterOutput(wav)
