# Grasshopper definition sketch3_shapes.gh (Grasshopper 0.9.75)
# plug-ins: Squid

rectpointoffset = Slider(60, range=0..100)
circlesnum = Slider(295, range=0..300)

# ---- group: Canvas
id = Guid(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)
rec = Rectangle(id)

# ----
neg = Negative(Value=rectpointoffset)
offset = Offset(Curve=rec, Distance=neg, Plane=PlaneXY(0, 0, 0), Corners=1)
angle_seed = Slider(92, range=0..100)
rad_seed = Slider(39, range=0..100)

# ---- group: DistanceDistr
dom = ConstructDomain(DomainStart=Slider(117, range=0..200), DomainEnd=Slider(519, range=0..1500))
random = Random(Range=dom, Number=circlesnum, Seed=rad_seed)
cluster = Cluster(num=random, bool=Toggle(True))  # -> R, i
domain = Domain(dom)
graph = GraphMapper(
    cluster.R,
    x0=0,
    x1=1,
    y0=0,
    y1=1,
    container_name="Bezier",
    cpx=[0, 0.3516674936, 0.6226668358, 1],
    cpy=[0, 0.1340575218, 0.5231884718, 1])
remap = RemapNumbers(Value=graph, Source=Domain(0, 1), Target=domain)  # -> Mapped, Clipped

# ----
cpoint_seed = Slider(95, range=0..100)

# ---- group: CenterPoint
pop2d = Populate2D(Region=offset, Count=1, Seed=cpoint_seed)
pt = Point(pop2d)

# ----
random_2 = Random(Range=Domain(0, 200), Number=circlesnum, Seed=angle_seed)
pt_2 = PointCylindrical(BasePlane=pt, Angle=random_2, Radius=remap.Mapped, Elevation=0)

# ---- group: Circles Radiuses
pt_3 = Point(pt_2)
pt_4 = Point(pt)
dist = Distance(PointA=pt_3, PointB=pt_4)
cluster_2 = Cluster(num=dist, bool=True)  # -> R, i
base_mult = Slider(31.2, range=0..100)
random_mult = Slider(2, range=1..2)
graph_2 = GraphMapper(
    cluster_2.R,
    x0=0,
    x1=1,
    y0=0,
    y1=1,
    container_name="Bezier",
    cpx=[0, 0.1748407334, 0.3195362985, 1],
    cpy=[1, 0.8433041573, 0.7468403578, 0.2904924154])
dom_2 = ConstructDomain(DomainStart=1, DomainEnd=random_mult)
multiplication = Multiplication(A=graph_2, B=base_mult)
random_3 = Random(Range=dom_2, Number=circlesnum, Seed=2)
multiplication_2 = Multiplication(A=multiplication, B=random_3)

# ---- group: center
pt_5 = Point(pt)

# ----
num = Number(multiplication_2)
pln = Plane(pt_2)
pln_2 = Plane(pln)

# ---- group: ortogonal
cluster_3 = Cluster_5(B=pln_2)

# ---- group: inside_out
cluster_4 = Cluster_4(P=pln_2, A=pt_5)

# ----
num_2 = Number(num)

pln_3 = Plane(cluster_3)
num_3 = Number(num)
rotate45 = Rotate45(pln=pln_3)
cluster_5 = Cluster_3(num=num_3, B=Slider(0.22, range=0..1))  # -> num_3, R
rectangle = Rectangle(Plane=pln_3, XSize=cluster_5.num_3, YSize=cluster_5.R, Radius=1000)  # -> Rectangle, Length

filletradius = Slider(0.15, range=0..1)
pln_4 = Plane(cluster_4)
multiplication_3 = Multiplication(A=num_2, B=filletradius)
polygon = Polygon(Plane=pln_4, Radius=num_2, Segments=3, FilletRadius=multiplication_3)  # -> Polygon, Length

num_4 = Number(num)
pln_5 = Plane(pln)
cir = Circle(Plane=pln_5, Radius=num_4)

crv = Curve(polygon.Polygon)
crv_2 = Curve(cir)
crv_3 = Curve(rectangle.Rectangle)
crv_4 = Curve(crv_3)

# ---- group: sort circle by radius
sort = SortList(Keys=crv_4, ValuesA=crv_4)  # -> Keys, ValuesA

# ----
list = ValueList({"Circle": "1_circle_", "Triangular": "2_triangular_", "Line": "3_line_"}, selected="Line")
digit_scroller = DigitScroller(Scroller_Digits=12, Scroller_Prefix="Fragment B", Scroller_Radix=11, Scroller_Value=17)
background = ColourSwatch(SwatchColor=RGB(0, 0, 0))
panel = Panel("""1_circle_
2_triangular_
3_line_""")
panel_2 = Panel("""0
1
2""")
outline = Outline(Color=background, Width=Slider(2, range=0..10))
concat = Concatenate(FragmentA=list, FragmentB=digit_scroller)
keysearch = KeyValueSearch(Keys=panel, Values=panel_2, Search=list)

# ---- group: background
background_2 = ColourSwatch(SwatchColor=RGB(0, 0, 0))
clear = Clear(Color=background_2)

# ----
save = Save(Folder="C:\Users\Филипп\Desktop\Generative_patters\imgs\sketch1", Filename=concat, Tiff=False)  # -> SquidInstr, Path; disabled
filter = StreamFilter(Gate=keysearch)

sort_2 = SortList(Keys=dist)  # -> Keys, ValuesA
far = ColourSwatch(SwatchColor=RGB(255, 0, 0))
close = ColourSwatch(SwatchColor=RGB(255, 255, 255))
range = Range(Domain=Domain(0, 1), Steps=10)
cluster_6 = Cluster_2(col=far, col_2=close, num=range)
legend = Legend(Colour=cluster_6, Tags=range, LegendType=101)

num_5 = Number(sort_2.Keys)
bnd = Bounds(Numbers=num_5)
remap_2 = RemapNumbers(Value=num_5, Source=bnd, Target=Domain(0, 1))  # -> Mapped, Clipped

graph_3 = GraphMapper(
    remap_2.Mapped,
    x0=0,
    x1=1,
    y0=0,
    y1=1,
    container_name="Bezier",
    cpx=[0, 0.5375074148, 0.8454496861, 1],
    cpy=[0, 0.2635356784, 0.552927196, 1])
pgradient = Cluster_2(col=far, col_2=close, num=graph_3)

draw = Draw(Curve=sort.ValuesA, Accuracy=-1, Fill=pgradient)  # -> SquidInstr, Curve
merge = Merge(Data1=flatten(clear), Data2=flatten(draw.SquidInstr), Data3=flatten(save.SquidInstr))
squid = Squid(BitmapR=rec, SquidInstr=merge, PPU=1, AA=True, autohide=False)
qpreview = QuickPreview(Bitmap=squid)

# ==== cluster Cluster
bool = ClusterInput()
num = ClusterInput()
bool_2 = Boolean(bool)
int = Integer(0)

num_2 = Number(num)
sort = SortList(Keys=num_2)  # -> Keys, ValuesA
item = ListItem(List=sort.Keys, Index=0, Wrap=True)

filter = StreamFilter(Gate=bool_2, Stream0=int, Stream1=item)
item_2 = ListItem(List=sort.Keys, Index=-1, Wrap=True)
dom = ConstructDomain(DomainStart=filter, DomainEnd=item_2)

remap = RemapNumbers(Value=num_2, Source=dom, Target=Domain(0, 1))  # -> Mapped, Clipped

i = ClusterOutput(item_2)
R = ClusterOutput(remap.Mapped)

# ==== cluster Cluster_2
col = ClusterInput()
col_2 = ClusterInput()
num = ClusterInput()
col_3 = Colour(col)
col_4 = Colour(col_2)
num_2 = Number(graft(num))
subtraction = Subtraction(A=1, B=num_2)
merge = Merge(Data1=subtraction, Data2=num_2)
wav = WeightedAverage(Input=[col_3, col_4], Weights=merge)  # -> flatten(ArithmeticMean)
am = ClusterOutput(wav)

# ==== cluster Cluster_3
B = ClusterInput()
num = ClusterInput()
num_2 = Number(num)
multiplication = Multiplication(A=num_2, B=B)
R = ClusterOutput(multiplication)
num_3 = ClusterOutput(num_2)

# ==== cluster Cluster_4
P = ClusterInput()
A = ClusterInput()

# ---- group: fromCenter
vec2pt = Vector2Pt(PointA=A, PointB=P, Unitize=False)  # -> Vector, Length
align = AlignPlane(Plane=P, Direction=vec2pt.Vector)  # -> Plane, Angle

# ----
P_2 = ClusterOutput(align.Plane)

# ==== cluster Cluster_5
range = Range(Domain=Domain(0, 6.283185307), Steps=4)
jitter = Jitter(List=range, Jitter=1, Seed=2)  # -> Values, Indices
B = ClusterInput()
long = LongestList(ListA=jitter.Values, ListB=B, PaddingMode=4)  # -> ListA, ListB
prot = RotatePlane(Plane=B, Angle=long.ListA)
P = ClusterOutput(prot)

# ==== cluster Rotate45
pln = ClusterInput()
pln_2 = Plane(pln)
rotate = Rotate(Geometry=pln_2, Angle=0.7853981634, Plane=pln_2)  # -> Geometry, Transform
pln_3 = Plane(rotate.Geometry)
pln_4 = ClusterOutput(pln_3)
