# Grasshopper definition sketch4_shapes.gh (Grasshopper 0.9.75)
# plug-ins: Squid

rectpointoffset = Slider(60, range=0..100)
circlesnum = Slider(512, range=0..1000)

# ---- group: Baseector
Z = UnitZ(Factor=1)
Y = UnitY(Factor=1)
pi = Pi(Factor=Slider(3.7, range=0..10))
vrot = Rotate(Vector=Y, Axis=Z, Angle=pi)

# ---- group: Canvas
id = Guid(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)
rec = Rectangle(id)

# ----
neg = Negative(Value=rectpointoffset)
offset = Offset(Curve=rec, Distance=neg, Plane=PlaneXY(0, 0, 0), Corners=1)
angle_seed = Slider(92, range=0..100)
rad_seed = Slider(39, range=0..100)

# ---- group: DistanceDistr
dom = ConstructDomain(DomainStart=Slider(59, range=0..200), DomainEnd=Slider(519, range=0..1500))
random = Random(Range=dom, Number=circlesnum, Seed=rad_seed)
cluster = Cluster(num=random, bool=Toggle(False))  # -> R, i
domain = Domain(dom)
graph = GraphMapper(
    cluster.R,
    x0=0,
    x1=1,
    y0=0,
    y1=1,
    container_name="Bezier",
    cpx=[0, 0, 0.3753599823, 1],
    cpy=[0, 0.05895644426, 0.007014155388, 1])
remap = RemapNumbers(Value=graph, Source=Domain(0, 1), Target=domain)  # -> Mapped, Clipped

# ----
cpoint_seed = Slider(95, range=0..100)

# ---- group: CenterPoint
pop2d = Populate2D(Region=offset, Count=1, Seed=cpoint_seed)
pt = Point(pop2d)

# ----
dom_2 = ConstructDomain(DomainStart=Slider(0.66, range=0..1), DomainEnd=Slider(1, range=0..1))
negtopos = NegToPos_2(A=Slider(0.394, range=0..0.5), B=Slider(0.036, range=0..0.5))

# ---- group: RandomAdder
negtopos_2 = NegToPos(B=Slider(17, range=0..100))
num = Number(remap.Mapped)
lng = ListLength(List=num)
random_2 = Random(Range=negtopos_2, Number=lng, Seed=2)
addition = Addition(A=num, B=random_2)

# ----
hsl = ColourHSL(Alpha=1, Hue=0.5, Saturation=1, Luminance=0.5)
random_3 = Random(Range=Domain(0, 200), Number=circlesnum, Seed=angle_seed)
pt_2 = PointCylindrical(BasePlane=pt, Angle=random_3, Radius=addition, Elevation=0)

# ---- group: Circles Radiuses
pt_3 = Point(pt_2)
pt_4 = Point(pt)
dist = Distance(PointA=pt_3, PointB=pt_4)
cluster_2 = Cluster(num=dist, bool=True)  # -> R, i
base_mult = Slider(31.2, range=0..100)
random_mult = Slider(2, range=1..2)
graph_2 = GraphMapper(
    cluster_2.R,
    x0=0,
    x1=1,
    y0=0,
    y1=1,
    container_name="Bezier",
    cpx=[0, 0.1748407334, 0.3195362985, 1],
    cpy=[1, 0.8433041573, 0.7468403578, 0.2904924154])
dom_3 = ConstructDomain(DomainStart=1, DomainEnd=random_mult)
multiplication = Multiplication(A=graph_2, B=base_mult)
random_4 = Random(Range=dom_3, Number=circlesnum, Seed=2)
multiplication_2 = Multiplication(A=multiplication, B=random_4)

# ---- group: center
pt_5 = Point(pt)

# ----
num_2 = Number(multiplication_2)
pln = Plane(pt_2)
pln_2 = Plane(pln)

# ---- group: ortogonal
cluster_3 = Cluster_4(B=pln_2)

# ----
rotate45 = Rotate45()  # disabled
dom_4 = ConstructDomain(DomainStart=Slider(0.084, range=0..1), DomainEnd=Slider(0.262, range=0..1))
num_3 = Number(num_2)
genes = GenePool(Decimals=2, Maximum=1, Minimum=0, Value=[0.5, 0.89, 0.5, 0.86])

pln_3 = Plane(cluster_3)
num_4 = Number(num_2)
cluster_4 = Cluster_3(num=num_4, B=Slider(0.22, range=0..1))  # -> num_3, R
rectangle = Rectangle(Plane=pln_3, XSize=cluster_4.num_3, YSize=cluster_4.R, Radius=1000)  # -> Rectangle, Length

filletradius = Slider(0.15, range=0..1)  # disabled
pln_4 = Plane(cluster_3)  # disabled
multiplication_3 = Multiplication(A=num_3, B=filletradius)  # disabled
polygon = Polygon(Plane=pln_4, Radius=num_3, Segments=3, FilletRadius=multiplication_3)  # -> Polygon, Length; disabled

num_5 = Number(num_2)  # disabled
pln_5 = Plane(pln)  # disabled
cir = Circle(Plane=pln_5, Radius=num_5)  # disabled

long = LongestList(
    ListA=genes,
    ListB=ColourSwatch(SwatchColor=RGB(255, 255, 255)),
    ListC=ColourSwatch(SwatchColor=RGB(255, 0, 0)),
    PaddingMode=2)  # -> ListA, ListB, ListC
p_n_c = PickNChoose(Pattern=long.ListA, Stream0=long.ListB, Stream1=long.ListC)
legend = Legend(Colour=p_n_c, Tags=["One Fish", "Two Fish", "Red Fish", "Blue Fish"], LegendType=1)
crv = Curve(cir)
crv_2 = Curve(rectangle.Rectangle)
crv_3 = Curve(polygon.Polygon)
list = ValueList({"Lines": 0, "Triangles": 1, "Circles": 2}, selected="Lines")
filter = StreamFilter(Gate=list, Stream0=crv_2, Stream1=crv_3, Stream2=crv)

# ---- group: Render / background
background = ColourSwatch(SwatchColor=RGB(0, 0, 0))
clear = Clear(Color=background)

# ---- group: VtoPoints
pt_6 = Point(pt)

# ----
vdis = VectorDisplay(Anchor=pt_6, Vector=vrot)

sort = SortList(Keys=dist)  # -> Keys, ValuesA
far = ColourSwatch(SwatchColor=RGB(255, 0, 0))
close = ColourSwatch(SwatchColor=RGB(255, 174, 0))
range = Range(Domain=Domain(0, 1), Steps=10)
cluster_5 = Cluster_2(col=far, col_2=close, num=range)
legend_2 = Legend(Colour=cluster_5, Tags=range, LegendType=101)

num_6 = Number(sort.Keys)
bnd = Bounds(Numbers=num_6)
remap_2 = RemapNumbers(Value=num_6, Source=bnd, Target=Domain(0, 1))  # -> Mapped, Clipped

graph_3 = GraphMapper(
    remap_2.Mapped,
    x0=0,
    x1=1,
    y0=0,
    y1=1,
    container_name="Bezier",
    cpx=[0, 0.5375074148, 0.8454496861, 1],
    cpy=[0, 0.2635356784, 0.552927196, 1])
pgradient = Cluster_2(col=far, col_2=close, num=graph_3)

# ---- group: Render
crv_4 = Curve(filter)
list_2 = ValueList({"Circle": "1_circle_", "Triangular": "2_triangular_", "Line": "3_line_"}, selected="Line")
digit_scroller = DigitScroller(Scroller_Digits=12, Scroller_Prefix="Fragment B", Scroller_Radix=11, Scroller_Value=17)
background_2 = ColourSwatch(SwatchColor=RGB(0, 0, 0))
panel = Panel("""1_circle_
2_triangular_
3_line_""")
panel_2 = Panel("""0
1
2""")
outline = Outline(Color=background_2, Width=Slider(2, range=0..10))
concat = Concatenate(FragmentA=list_2, FragmentB=digit_scroller)
keysearch = KeyValueSearch(Keys=panel, Values=panel_2, Search=list_2)
save = Save(Folder="C:\Users\Филипп\Desktop\Generative_patters\imgs\sketch1", Filename=concat, Tiff=False)  # -> SquidInstr, Path; disabled
filter_2 = StreamFilter(Gate=keysearch)
rec_2 = Rectangle(rec)

# ---- group: Render / sort circle by radius
sort_2 = SortList(Keys=crv_4, ValuesA=crv_4, ValuesB=pt_2)  # -> Keys, ValuesA, ValuesB

# ---- group: VtoPoints (continued)
pt_7 = Point(sort_2.ValuesB)
vec2pt = Vector2Pt(PointA=pt_6, PointB=pt_7, Unitize=False)  # -> Vector, Length

# ----
angle = Angle(VectorA=vrot, VectorB=vec2pt.Vector)  # -> Angle, Reflex
num_7 = Number(vec2pt.Length)
num_8 = Number(angle.Angle)
eval = Evaluate(F="if(x≤Pi,x-0.5*Pi,1.5*Pi-x)", x=num_8)
bnd_2 = Bounds(Numbers=num_7)
remap_3 = RemapNumbers(Value=num_7, Source=bnd_2, Target=negtopos)  # -> Mapped, Clipped
remap_4 = RemapNumbers(Value=num_7, Source=bnd_2, Target=dom_2)  # -> Mapped, Clipped
larger = LargerThan(FirstNumber=num_7, SecondNumber=Slider(450, range=0..1000))  # -> LargerThan, OrEqualTo
smaller = SmallerThan(FirstNumber=eval, SecondNumber=Slider(0.33, range=0..1))  # -> SmallerThan, OrEqualTo
larger_2 = LargerThan(FirstNumber=eval, SecondNumber=Slider(0.45, range=0..1))  # -> LargerThan, OrEqualTo
pie = PieChart(larger.LargerThan)
and = GateAnd(A=larger_2.LargerThan, B=larger.LargerThan)
and_2 = GateAnd(A=smaller.SmallerThan, B=larger.LargerThan)
lng_2 = ListLength(List=and)
repeat = RepeatData(Data=Slider(0.56, range=0..1), Length=lng_2)
ma = MassAddition(Input=and)  # -> Result, PartialResults
ma_2 = MassAddition(Input=and_2)  # -> Result, PartialResults
random_5 = Random(Range=dom_4, Number=ma_2.Result, Seed=2)
random_6 = Random(Range=dom_4, Number=ma.Result, Seed=2)
cluster_6 = Cluster_5(num=repeat, bool=and, B=random_6)
neg_2 = Negative(Value=random_5)
cluster_7 = Cluster_5(num=cluster_6, bool=and_2, B=neg_2)
or = GateOr(A=and_2, B=and)
dispatch = Dispatch(List=repeat, DispatchPattern=or)  # -> ListA, ListB
lng_3 = ListLength(List=dispatch.ListB)
repeat_2 = RepeatData(Data=Slider(0.43, range=0..1), Length=lng_3)
weave = Weave(Pattern=or, Stream0=dispatch.ListA, Stream1=repeat_2, NullGaps=False)
division = Division(A=remap_3.Mapped, B=weave)
hsl_2 = ColourHSL(Alpha=1, Hue=division, Saturation=1, Luminance=remap_4.Mapped)

# ---- group: Render (continued)
col = Colour(hsl_2)
draw = Draw(Curve=sort_2.ValuesA, Accuracy=-1, Fill=col)  # -> SquidInstr, Curve
merge = Merge(Data1=flatten(clear), Data2=flatten(draw.SquidInstr), Data3=flatten(save.SquidInstr))
squid = Squid(BitmapR=rec_2, SquidInstr=merge, PPU=1, AA=True, autohide=False)

# ==== cluster Cluster
bool = ClusterInput()
num = ClusterInput()
bool_2 = Boolean(bool)
int = Integer(0)

num_2 = Number(num)
sort = SortList(Keys=num_2)  # -> Keys, ValuesA
item = ListItem(List=sort.Keys, Index=0, Wrap=True)

filter = StreamFilter(Gate=bool_2, Stream0=int, Stream1=item)
item_2 = ListItem(List=sort.Keys, Index=-1, Wrap=True)
dom = ConstructDomain(DomainStart=filter, DomainEnd=item_2)

remap = RemapNumbers(Value=num_2, Source=dom, Target=Domain(0, 1))  # -> Mapped, Clipped

i = ClusterOutput(item_2)
R = ClusterOutput(remap.Mapped)

# ==== cluster Cluster_2
col = ClusterInput()
col_2 = ClusterInput()
num = ClusterInput()
col_3 = Colour(col)
col_4 = Colour(col_2)
num_2 = Number(graft(num))
subtraction = Subtraction(A=1, B=num_2)
merge = Merge(Data1=subtraction, Data2=num_2)
wav = WeightedAverage(Input=[col_3, col_4], Weights=merge)  # -> flatten(ArithmeticMean)
am = ClusterOutput(wav)

# ==== cluster Cluster_3
num = ClusterInput()
num_2 = Number(num)
B = ClusterInput()
multiplication = Multiplication(A=num_2, B=B)
R = ClusterOutput(multiplication)
num_3 = ClusterOutput(num_2)

# ==== cluster Cluster_4
range = Range(Domain=Domain(0, 6.283185307), Steps=4)
jitter = Jitter(List=range, Jitter=1, Seed=2)  # -> Values, Indices
B = ClusterInput()
long = LongestList(ListA=jitter.Values, ListB=B, PaddingMode=4)  # -> ListA, ListB
prot = RotatePlane(Plane=B, Angle=long.ListA)
P = ClusterOutput(prot)

# ==== cluster Rotate45
pln = ClusterInput()
pln_2 = Plane(pln)
rotate = Rotate(Geometry=pln_2, Angle=0.7853981634, Plane=pln_2)  # -> Geometry, Transform
pln_3 = Plane(rotate.Geometry)
pln_4 = ClusterOutput(pln_3)

# ==== cluster NegToPos
B = ClusterInput()
neg = Negative(Value=B)
dom = ConstructDomain(DomainStart=neg, DomainEnd=B)
I = ClusterOutput(dom)

# ==== cluster NegToPos_2
A = ClusterInput()
B = ClusterInput()
addition = Addition(A=A, B=B)
subtraction = Subtraction(A=A, B=B)
dom = ConstructDomain(DomainStart=subtraction, DomainEnd=addition)
I = ClusterOutput(dom)

# ==== cluster Cluster_5
num = ClusterInput()
bool = ClusterInput()
B = ClusterInput()
bool_2 = Boolean(bool)
num_2 = Number(num)
dispatch = Dispatch(List=num_2, DispatchPattern=bool_2)  # -> ListA, ListB
addition = Addition(A=dispatch.ListA, B=B)
weave = Weave(Pattern=bool_2, Stream0=dispatch.ListB, Stream1=addition, NullGaps=False)
num_3 = Number(weave)
num_4 = ClusterOutput(num_3)
