# Grasshopper definition sketch5_colors.gh (Grasshopper 0.9.75)
# plug-ins: Squid

rectpointoffset = Slider(60, range=0..100)
circlesnum = Slider(512, range=0..1000)
cpoint_seed = Slider(95, range=0..100)
color_seed = Slider(57, range=0..100)
rad_seed = Slider(54, range=0..100)
angle_seed = Slider(92, range=0..100)

# ---- group: Canvas
id = Guid(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)
rec = Rectangle(id)

# ----
neg = Negative(Value=rectpointoffset)
num = Number(Slider(1, range=0..100))
offset = Offset(Curve=rec, Distance=neg, Plane=PlaneXY(0, 0, 0), Corners=1)

# ---- group: CenterPoint
pop2d = Populate2D(Region=offset, Count=1, Seed=cpoint_seed)
pt = Point(pop2d)

# ----
random = Random(Range=Domain(0, 200), Number=circlesnum, Seed=angle_seed)
cluster = Cluster_4(num=Slider(26, range=0..100))
pt_2 = Point(pt)

# ---- group: BaseColor
number_slider = Slider(0.677, range=0..1)
cluster_2 = Cluster_3(base=number_slider, delta=Slider(0.142, range=0..0.5))
domaintocolorshsv = DomainToColorsHSV(I=cluster_2)
legend = Legend(Colour=domaintocolorshsv, Tags=["Low", "Center", "Hight"], LegendType=1)

# ----
multiplication = Multiplication(A=number_slider, B=100)
int = Integer(multiplication)
concat = Concatenate(FragmentA="palette_", FragmentB=int)
dom = ConstructDomain(DomainStart=Slider(0.566, range=0..1), DomainEnd=Slider(0.86, range=0..1))
dom_2 = ConstructDomain(DomainStart=Slider(1.032, range=1..2), DomainEnd=Slider(1.21, range=1..2))
dom_3 = ConstructDomain(DomainStart=Slider(0, range=0..100), DomainEnd=Slider(34, range=0..100))
rotate45 = Rotate45()  # disabled
txt = Text(concat)

# ---- group: background
background = ColourSwatch(SwatchColor=RGB(0, 0, 0))
clear = Clear(Color=background)

# ---- group: gauss_distr
int_2 = Integer(circlesnum)
c_script = CSharpScript(
    mean=num,
    std=Slider(1.282, range=0..2),
    N=int_2,
    seed=rad_seed,
    TooltipDescriptionOverride="using Box-Multer transformation",
    TooltipTextOverride="Gassian Random")  # -> out, A; inputs mean: Double, std: Double, N: Int32, seed: Int32
# ---------- c_script: C# ----------
    Random rand = new Random(seed);
    double[] rArray = new double[N];

    for (int i = 0; i < N; i++){

      double u1 = rand.NextDouble();
      double u2 = rand.NextDouble();

      double randStdNormal = Math.Sqrt(-2.0 * Math.Log(u1)) * Math.Sin(2.0 * Math.PI * u2);

      rArray[i] = mean + std * randStdNormal;
    }
    A = rArray;
# ---------- end c_script ----------
dom_4 = ConstructDomain(DomainStart=Slider(2, range=-1..1000), DomainEnd=Slider(94, range=0..100))
dom_5 = ConstructDomain(DomainStart=Slider(0, range=0..1000), DomainEnd=Slider(1252, range=0..1500))

# ----
eval = Evaluate(F="if(x>y,y+z*(x-y),y)", x=c_script.A, y=num, z=Slider(2, range=1..2))

# ---- group: gauss_distr (continued)
multiplication_2 = Multiplication(A=eval, B=Slider(1, range=0..40))

# ----
bnd = Bounds(Numbers=multiplication_2)
dedomain = DeconstructDomain(Domain=bnd)  # -> Start, End

# ---- group: gauss_distr (continued)
remap = RemapNumbers(Value=multiplication_2, Source=dedomain.End, Target=dom_5)  # -> Mapped, Clipped

# ----
lng = ListLength(List=remap.Mapped)
random_2 = Random(Range=cluster, Number=lng, Seed=2)
addition = Addition(A=random_2, B=remap.Mapped)

# ---- group: gauss_distr (continued)
bar_graph = BarGraph(addition, BarColor=RGB(255, 0, 90))

# ----
num_2 = Number(addition)
eval_2 = Evaluate(F="if(x<0,y+π,y)", x=num_2, y=random)
abs = Absolute(Value=num_2)
pt_3 = PointCylindrical(BasePlane=pt, Angle=eval_2, Radius=abs, Elevation=0)
pt_4 = Point(pt_3)

pt_5 = Point(pt_4)
pt_6 = Point(pt_2)

vec2pt = Vector2Pt(PointA=pt_6, PointB=pt_5, Unitize=False)  # -> Vector, Length

# ---- group: Base vector
Z = UnitZ(Factor=1)
Y = UnitY(Factor=1)
pi = Pi(Factor=Slider(0.71, range=0..2))
vrot = Rotate(Vector=Y, Axis=Z, Angle=pi)
vdis = VectorDisplay(Anchor=pt_6, Vector=vrot)

# ----
sort = SortList(Keys=vec2pt.Length, ValuesA=vec2pt.Vector, ValuesB=pt_5)  # -> Keys, ValuesA, ValuesB
num_3 = Number(sort.Keys)
vec = Vector(sort.ValuesA)
pt_7 = Point(sort.ValuesB)
num_4 = Number(num_3)
lng_2 = ListLength(List=num_4)
subtraction = Subtraction(A=lng_2, B=2)

# ---- group: angle_mulyplier
angle = Angle(VectorA=vrot, VectorB=vec)  # -> Angle, Reflex
number_slider_2 = Slider(0.49, range=0..1.5)
num_5 = Number(angle.Angle)
eval_3 = Evaluate(F="if(x≤Pi,x-0.5*Pi,1.5*Pi-x)", x=num_5)
bnd_2 = Bounds(Numbers=eval_3)
larger = LargerThan(FirstNumber=num_4, SecondNumber=Slider(234, range=0..1800))  # -> LargerThan, OrEqualTo
neg_2 = Negative(Value=number_slider_2)
smaller = SmallerThan(FirstNumber=eval_3, SecondNumber=neg_2)  # -> SmallerThan, OrEqualTo
larger_2 = LargerThan(FirstNumber=eval_3, SecondNumber=number_slider_2)  # -> LargerThan, OrEqualTo
and = GateAnd(A=larger_2.LargerThan, B=larger.LargerThan)
and_2 = GateAnd(A=smaller.SmallerThan, B=larger.LargerThan)

# ----
range = Range(Domain=Domain(0, 1), Steps=subtraction)
remap_2 = RemapNumbers(Value=range, Source=Domain(0, 1), Target=cluster_2)  # -> Mapped, Clipped
pie = PieChart(larger.LargerThan)
num_6 = Number(remap_2.Mapped)
multchosenbyrandom = MultChosenByRandom(num=num_6, bool=and, R=dom, S=color_seed)  # -> num_4, W
num_7 = Number(num_4)
cube = Cube(Value=num_7)
num_8 = Number(num_7)
multchosenbyrandom_2 = MultChosenByRandom(num=multchosenbyrandom.num_4, bool=and_2, R=dom_2, S=color_seed)  # -> num_4, W
multiplication_3 = Multiplication(A=multchosenbyrandom_2.W, B=multchosenbyrandom.W)
num_9 = Number(multchosenbyrandom_2.num_4)
remap_3 = RemapNumbers(Value=num_8, Source="1040 to 0", Target=dom_3)  # -> Mapped, Clipped
multiplication_4 = Multiplication(A=multiplication_3, B=remap_3.Mapped)
num_10 = Number(multiplication_4)
hsl = ColourHSL(Alpha=1, Hue=num_9, Saturation=1, Luminance=0.5)
bar_graph_2 = BarGraph(num_10, BarColor=RGB(255, 0, 90))

col = Colour(hsl)
num_11 = Number(num_10)

pt_8 = Point(pt_7)
pln = Plane(pt_8)
num_12 = Number(num_11)
pln_2 = Plane(pln)
num_13 = Number(num_12)

# ---- group: ortogonal
cluster_3 = Cluster_2(B=pln_2)

# ----
filletradius = Slider(0.15, range=0..1)  # disabled
pln_3 = Plane(cluster_3)  # disabled
multiplication_5 = Multiplication(A=num_13, B=filletradius)  # disabled
polygon = Polygon(Plane=pln_3, Radius=num_13, Segments=3, FilletRadius=multiplication_5)  # -> Polygon, Length; disabled

pln_4 = Plane(cluster_3)  # disabled
num_14 = Number(num_12)  # disabled
number_slider_3 = Slider(0.22, range=0..1)  # disabled
cluster_4 = Cluster(num=num_14, B=number_slider_3)  # -> num_3, R; disabled
rectangle = Rectangle(Plane=pln_4, XSize=cluster_4.num_3, YSize=cluster_4.R, Radius=1000)  # -> Rectangle, Length; disabled

num_15 = Number(num_12)
pln_5 = Plane(pln)
cir = Circle(Plane=pln_5, Radius=num_15)

crv = Curve(cir)
crv_2 = Curve(rectangle.Rectangle)
crv_3 = Curve(polygon.Polygon)
num_16 = Number(num_11)

list = ValueList({"Lines": 0, "Triangles": 1, "Circles": 2}, selected="Circles")
filter = StreamFilter(Gate=list, Stream0=crv_2, Stream1=crv_3, Stream2=crv)
col_2 = Colour(col)
list_2 = ValueList({"Circle": "1_circle_", "Triangular": "2_triangular_", "Line": "3_line_"}, selected="Line")
digit_scroller = DigitScroller(Scroller_Digits=12, Scroller_Prefix="Fragment B", Scroller_Radix=11, Scroller_Value=17)
background_2 = ColourSwatch(SwatchColor=RGB(0, 0, 0))
panel = Panel("""1_circle_
2_triangular_
3_line_""")
panel_2 = Panel("""0
1
2""")
outline = Outline(Color=background_2, Width=Slider(2, range=0..10))
concat_2 = Concatenate(FragmentA=list_2, FragmentB=digit_scroller)
keysearch = KeyValueSearch(Keys=panel, Values=panel_2, Search=list_2)
save = Save(Folder="C:\Users\Филипп\Desktop\Generative_patters\imgs\sketch1", Filename="superblob2", Tiff=False)  # -> SquidInstr, Path; disabled
filter_2 = StreamFilter(Gate=keysearch)
rec_2 = Rectangle(rec)

sort_2 = SortList(Keys=num_16, ValuesA=filter, ValuesB=col_2)  # -> Keys, ValuesA, ValuesB

crv_4 = Curve(sort_2.ValuesA)
draw = Draw(Curve=crv_4, Accuracy=-1, Fill=sort_2.ValuesB)  # -> SquidInstr, Curve
merge = Merge(Data1=flatten(clear), Data2=flatten(draw.SquidInstr), Data3=flatten(save.SquidInstr))
squid = Squid(BitmapR=rec_2, SquidInstr=merge, PPU=1, AA=True, autohide=False)

# ==== cluster Cluster
num = ClusterInput()
num_2 = Number(num)
B = ClusterInput()
multiplication = Multiplication(A=num_2, B=B)
R = ClusterOutput(multiplication)
num_3 = ClusterOutput(num_2)

# ==== cluster Cluster_2
range = Range(Domain=Domain(0, 6.283185307), Steps=4)
jitter = Jitter(List=range, Jitter=1, Seed=2)  # -> Values, Indices
B = ClusterInput()
long = LongestList(ListA=jitter.Values, ListB=B, PaddingMode=4)  # -> ListA, ListB
prot = RotatePlane(Plane=B, Angle=long.ListA)
P = ClusterOutput(prot)

# ==== cluster Rotate45
pln = ClusterInput()
pln_2 = Plane(pln)
rotate = Rotate(Geometry=pln_2, Angle=0.7853981634, Plane=pln_2)  # -> Geometry, Transform
pln_3 = Plane(rotate.Geometry)
pln_4 = ClusterOutput(pln_3)

# ==== cluster Cluster_3
base = ClusterInput()
delta = ClusterInput()
subtraction = Subtraction(A=base, B=delta)
addition = Addition(A=base, B=delta)
dom = ConstructDomain(DomainStart=subtraction, DomainEnd=addition)
I = ClusterOutput(dom)

# ==== cluster DomainToColorsHSV
I = ClusterInput()
dedomain = DeconstructDomain(Domain=I)  # -> Start, End
avr = Average(Input=[dedomain.Start, dedomain.End])
merge = Merge(Data1=dedomain.Start, Data2=avr, Data3=dedomain.End)
hsl = ColourHSL(Alpha=1, Hue=merge, Saturation=1, Luminance=0.5)
C = ClusterOutput(hsl)

# ==== cluster MultChosenByRandom
num = ClusterInput()
S = ClusterInput()
R = ClusterInput()
bool = ClusterInput()
bool_2 = Boolean(bool)
num_2 = Number(num)
not = GateNot(A=bool_2)
ma = MassAddition(Input=not)  # -> Result, PartialResults
ma_2 = MassAddition(Input=bool_2)  # -> Result, PartialResults
random = Random(Range=R, Number=ma_2.Result, Seed=S)
repeat = RepeatData(Data=1, Length=ma.Result)
weave = Weave(Pattern=bool_2, Stream0=repeat, Stream1=random, NullGaps=False)
multiplication = Multiplication(A=num_2, B=weave)
num_3 = Number(multiplication)
W = ClusterOutput(weave)
num_4 = ClusterOutput(num_3)

# ==== cluster Cluster_4
num = ClusterInput()
num_2 = Number(num)
neg = Negative(Value=num_2)
dom = ConstructDomain(DomainStart=neg, DomainEnd=num_2)
I = ClusterOutput(dom)
