# Grasshopper definition sketch8_panel.gh (Grasshopper 0.9.75)
# plug-ins: Squid

panel = Panel("""На чем можно сэкономить при устройстве теплой кровли?
Част 1: Как прокормить Щенка
Часть 2: Как избавиться от собаки
Любовь""")
paid = BooleanToggle(False)
open = BooleanToggle(False)
item = ListItem(List=panel, Index=Slider(1, range=0..10), Wrap=True)

# ---- group: DataPanel
duration = Integer("156")
name = Text(item)
type = Text("hozyaystvo")
days = Integer("0")
paid_2 = Boolean(paid)
uid = Integer("5634")

# ----
open_2 = Boolean(open)
tag = Integer(Slider(0, range=0..2))
int = Integer(days)
concat = Concatenate(FragmentA="days_line", FragmentB=int)
remap = RemapNumbers(Value=days, Source=Domain(0, 30), Target=Domain(1, 0))  # -> Mapped, Clipped
remap_2 = RemapNumbers(Value=duration, Source=Domain(0, 180), Target=Domain(0, 1))  # -> Mapped, Clipped
cluster = Cluster_4(T=name, B=uid)
panel_2 = Panel("""hozyaystvo
business
design
finance
psicology""")
panel_3 = Panel("""1
2
3
4
5""")
keysearch = KeyValueSearch(Keys=panel_2, Values=panel_3, Search=type)
circlesnum = Slider(400, range=0..1000)
angle_seed = Slider(81, range=0..100)
rad_seed = Slider(89, range=0..100)
color_seed = Slider(52, range=0..100)

# ---- group: Canvas
id = Guid(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)
rec = Rectangle(id)

# ----
cluster_2 = Cluster_6(rec=rec, seed=uid, V=remap.Clipped)  # -> G, dsh
number_slider = Slider(14, range=0..30)
number_slider_2 = Slider(310, range=180..350)
remap_3 = RemapNumbers(Value=number_slider_2, Source=Domain(180, 350), Target=Domain(30, 110))  # -> Mapped, Clipped
pt = Point(cluster_2.G)
multiplication = Multiplication(A=remap_3.Mapped, B=remap_2.Clipped)
cluster_3 = Cluster_2(base=number_slider_2, delta=multiplication)
random = Random(Range=Domain(0, 200), Number=circlesnum, Seed=angle_seed)
num = Number(cluster_2.dsh)

# ---- group: daily_Shift
addition = Addition(A=random, B=num)

# ----
pt_2 = Point(pt)
pt_3 = Point(pt_2)

num_2 = Number(cluster)
addition_2 = Addition(A=Slider(0, range=0..1), B=num_2)

# ---- group: Base vector
Z = UnitZ(Factor=1)
Y = UnitY(Factor=1)
pi = Pi(Factor=Slider(0.67, range=0..2))
vrot = Rotate(Vector=Y, Axis=Z, Angle=pi)
vdis = VectorDisplay(Anchor=pt_3, Vector=vrot)

# ----
num_3 = Number(Slider(0, range=0..1))

# ---- group: BaseColor
cluster_4 = Cluster_2(base=num_3, delta=Slider(0.137, range=0..0.5))
domaintocolorshsv = DomainToColorsHSV(I=cluster_4)
legend = Legend(Colour=domaintocolorshsv, Tags=["Low", "Center", "Hight"], LegendType=1)

# ----
number_slider_3 = Slider(0.9, range=0..1)
multiplication_2 = Multiplication(A=number_slider_3, B=100)
hsl = ColourHSL(Alpha=1, Hue=number_slider_3, Saturation=1, Luminance=Slider(0.2, range=0..1))
col = Colour(hsl)
legend_2 = Legend(Colour=col, Tags="Background", LegendType=1)

bool = Boolean()
bool_2 = Boolean(False)

number_slider_4 = Slider(47, range=0..1000)  # disabled
number_slider_5 = Slider(100, range=0..1000)  # disabled
number_slider_6 = Slider(100, range=0..1000)  # disabled
c_script = CSharpScript(h=number_slider_4, S=number_slider_5, V=number_slider_6)  # -> out, r, g, b; inputs h: Double, S: Double, V: Double; disabled
# ---------- c_script: C# ----------
    double H = h;

    while (H < 0) { H += 360; };
    while (H >= 360) { H -= 360; };
    double R, G, B;
    if (V <= 0)
    { R = G = B = 0; }
    else if (S <= 0)
    {
      R = G = B = V;
    }
    else
    {
      double hf = H / 60.0;
      int i = (int) Math.Floor(hf);
      double f = hf - i;
      double pv = V * (1 - S);
      double qv = V * (1 - S * f);
      double tv = V * (1 - S * (1 - f));
      switch (i)
      {

        // Red is the dominant color

        case 0:
          R = V;
          G = tv;
          B = pv;
          break;

        // Green is the dominant color

        case 1:
          R = qv;
          G = V;
          B = pv;
          break;
        case 2:
          R = pv;
          G = V;
          B = tv;
          break;

        // Blue is the dominant color

        case 3:
          R = pv;
          G = qv;
          B = V;
          break;
        case 4:
          R = tv;
          G = pv;
          B = V;
          break;

        // Red is the dominant color

        case 5:
          R = V;
          G = pv;
          B = qv;
          break;

        // Just in case we overshoot on our math by a little, we put these here. Since its a switch it won't slow us down at all to put these here.

        case 6:
          R = V;
          G = tv;
          B = pv;
          break;
        case -1:
          R = V;
          G = pv;
          B = qv;
          break;

        // The color is not defined, we should throw an error.

        default:
          //LFATAL("i Value error in Pixel conversion, Value is %d", i);
          R = G = B = V; // Just pretend its black/white
          break;
      }
    }
    R = R * 255.0;
    G = G * 255.0;
    B = B * 255.0;

    if(R > 255.0){R = 255.0;}
    if(G > 255.0){G = 255.0;}
    if(B > 255.0){B = 255.0;}

    if(R < 0){R = 0.0;}
    if(G < 0){G = 0.0;}
    if(B < 0){B = 0.0;}

    r = R;
    g = G;
    b = B;
# ---------- end c_script ----------
remap_4 = RemapNumbers(Value=c_script.r, Source=Domain(0, 255), Target=Domain(0, 1))  # -> Mapped, Clipped; disabled
remap_5 = RemapNumbers(Value=c_script.g, Source=Domain(0, 255), Target=Domain(0, 1))  # -> Mapped, Clipped; disabled
remap_6 = RemapNumbers(Value=c_script.b, Source=Domain(0, 255), Target=Domain(0, 1))  # -> Mapped, Clipped; disabled
rgb = ColourRGB(Alpha=255, Red=remap_4.Mapped, Green=remap_5.Mapped, Blue=remap_6.Mapped)  # disabled
legend_3 = Legend(Colour=rgb, Tags="One Fish", LegendType=1)  # disabled

pt_4 = Point()
int_2 = Integer(tag)
txt = Text(concat)
panel_4 = Panel("experiment4")

# ---- group: background
background = ColourSwatch(SwatchColor=RGB(0, 0, 0))
clear = Clear(Color=background)

# ----
int_3 = Integer(circlesnum)
c_script_2 = CSharpScript(
    mean=0,
    std=1,
    N=int_3,
    seed=rad_seed,
    TooltipDescriptionOverride="using Box-Multer transformation",
    TooltipTextOverride="Gassian Random")  # -> out, A; inputs mean: Double, std: Double, N: Int32, seed: Int32
# ---------- c_script_2: C# ----------
    Random rand = new Random(seed);
    double[] rArray = new double[N];

    for (int i = 0; i < N; i++){

      double u1 = rand.NextDouble();
      double u2 = rand.NextDouble();

      double randStdNormal = Math.Sqrt(-2.0 * Math.Log(u1)) * Math.Sin(2.0 * Math.PI * u2);

      rArray[i] = mean + std * randStdNormal;
    }
    A = rArray;
# ---------- end c_script_2 ----------
multiplication_3 = Multiplication(A=c_script_2.A, B=Slider(16, range=0..40))
remap_7 = RemapNumbers(Value=multiplication_3, Source=Domain(0, 30), Target=Domain(5, 80))  # -> Mapped, Clipped
remap_8 = RemapNumbers(Value=remap_7.Mapped, Source=Domain(0, 150), Target=Domain(400, 0))  # -> Mapped, Clipped
cluster_5 = Cluster_3(num=Slider(12, range=0..100))
lng = ListLength(List=remap_8.Mapped)
random_2 = Random(Range=cluster_5, Number=lng, Seed=2)

remap_9 = RemapNumbers(Value=remap_8.Mapped, Source=Domain(300, 500), Target=cluster_3)  # -> Mapped, Clipped

addition_3 = Addition(A=random_2, B=remap_9.Mapped)

# ---- group: if
num_4 = Number(addition)
num_5 = Number(addition_3)

# ----
pt_5 = PointCylindrical(BasePlane=pt, Angle=num_4, Radius=num_5, Elevation=0)
pln = Plane(pt_5)
rotate = Rotate(Geometry=pln, Angle=num, Plane=pln)  # -> Geometry, Transform
pln_2 = Plane(rotate.Geometry)
pln_3 = Plane(pln_2)

vec2pt = Vector2Pt(PointA=pt_3, PointB=pln_3, Unitize=False)  # -> Vector, Length
sort = SortList(Keys=vec2pt.Length, ValuesA=vec2pt.Vector, ValuesB=pln_3)  # -> Keys, ValuesA, ValuesB
num_6 = Number(sort.Keys)
vec = Vector(sort.ValuesA)

pln_4 = Plane(sort.ValuesB)
num_7 = Number(num_6)
lng_2 = ListLength(List=num_7)
subtraction = Subtraction(A=lng_2, B=2)

# ---- group: angle_mulyplier
angle = Angle(VectorA=vrot, VectorB=vec)  # -> Angle, Reflex
distance = Slider(75, range=0..800)
num_8 = Number(angle.Angle)
angle_2 = Slider(0.02, range=0..1.5)
eval = Evaluate(F="if(x≤Pi,x-0.5*Pi,1.5*Pi-x)", x=num_8)
larger = LargerThan(FirstNumber=num_7, SecondNumber=distance)  # -> LargerThan, OrEqualTo
neg = Negative(Value=angle_2)
smaller = SmallerThan(FirstNumber=eval, SecondNumber=neg)  # -> SmallerThan, OrEqualTo
larger_2 = LargerThan(FirstNumber=eval, SecondNumber=angle_2)  # -> LargerThan, OrEqualTo
pie = PieChart(smaller.SmallerThan)
pie_2 = PieChart(larger.LargerThan)
and = GateAnd(A=larger_2.LargerThan, B=larger.LargerThan)
and_2 = GateAnd(A=smaller.SmallerThan, B=larger.LargerThan)

# ----
range = Range(Domain=Domain(0, 1), Steps=subtraction)
eval_2 = Evaluate(F="if(x≤1.5*Pi,if(x>0.5*Pi,true,false),false)", x=num_8)
remap_10 = RemapNumbers(Value=range, Source=Domain(0, 1), Target=cluster_4)  # -> Mapped, Clipped
and_3 = GateAnd(A=eval_2, B=larger.LargerThan)
neg_2 = Negative(Value=and_3)

dom = ConstructDomain(DomainStart=Slider(0.335, range=0..1), DomainEnd=Slider(0.842, range=0..1))
num_9 = Number(remap_10.Mapped)
multchosenbyrandom = MultChosenByRandom(num=num_9, bool=and_3, R=dom, S=color_seed)  # -> num_4, W
num_10 = Number(num_7)
cube = Cube(Value=num_10)
dom_2 = ConstructDomain(DomainStart=Slider(1, range=1..2), DomainEnd=Slider(1.41, range=1..2))
num_11 = Number(num_10)
multchosenbyrandom_2 = MultChosenByRandom(num=multchosenbyrandom.num_4, bool=neg_2, R=dom_2, S=color_seed)  # -> num_4, W
dom_3 = ConstructDomain(DomainStart=Slider(-70, range=-100..100), DomainEnd=Slider(60, range=0..100))
multiplication_4 = Multiplication(A=multchosenbyrandom_2.W, B=multchosenbyrandom.W)
num_12 = Number(multchosenbyrandom_2.num_4)
remap_11 = RemapNumbers(Value=num_11, Source="1200 to 0", Target=dom_3)  # -> Mapped, Clipped
eval_3 = Evaluate(F="if(x>1,x-Floor(x),if(x<0,x-Floor(x),x))", x=num_12)
multiplication_5 = Multiplication(A=multiplication_4, B=remap_11.Mapped)
hsl_2 = ColourHSL(Alpha=1, Hue=eval_3, Saturation=1, Luminance=0.5)
num_13 = Number(multiplication_5)
bar_graph = BarGraph(num_13, BarColor=RGB(255, 0, 90))

lng_3 = ListLength(List=num_9)
repeat = RepeatData(Data=bool_2, Length=lng_3)

col_2 = Colour(hsl_2)
num_14 = Number(num_13)

pln_5 = Plane(pln_4)

seed = Panel("2")
jitter = Jitter(List=col_2, Jitter=1, Seed=seed)  # -> Values, Indices
jitter_2 = Jitter(List=pln_5, Jitter=1, Seed=seed)  # -> Values, Indices
jitter_3 = Jitter(List=num_14, Jitter=1, Seed=seed)  # -> Values, Indices
lng_4 = ListLength(List=jitter.Values)
multiplication_6 = Multiplication(A=Slider(0.63, range=0..1), B=lng_4)
int_4 = Integer(multiplication_6)
split = SplitList(List=jitter_2.Values, Index=int_4)  # -> ListA, ListB
split_2 = SplitList(List=jitter_3.Values, Index=int_4)  # -> ListA, ListB

num_15 = Number(num_14)
pln_6 = Plane(pln_5)
pln_7 = Plane(pln_6)

# ---- group: ortogonal
cluster_6 = Cluster_5(B=pln_7)

# ----
num_16 = Number(num_15)
num_17 = Number(num_14)

bool_3 = Boolean(open_2)

gate = StreamGate(Stream=cluster_6, Gate=bool_3)  # -> Target0, Target1

rotate45 = Rotate45(pln=gate.Target1)
filter = StreamFilter(Gate=bool_3, Stream0=gate.Target0, Stream1=rotate45)

filletradius = Slider(0.15, range=0..1)
pln_8 = Plane(filter)
multiplication_7 = Multiplication(A=num_16, B=filletradius)
polygon = Polygon(Plane=pln_8, Radius=num_16, Segments=3, FilletRadius=multiplication_7)  # -> Polygon, Length

num_18 = Number(num_15)
pln_9 = Plane(filter)
cir = Circle(Plane=pln_9, Radius=num_18)

crv = Curve(polygon.Polygon)
crv_2 = Curve(cir)
merge = Merge(Data1=crv, Data2=crv_2)  # disabled

pln_10 = Plane(filter)
num_19 = Number(split_2.ListA)

multiplication_8 = Multiplication(A=num_19, B=Slider(2.53, range=0..10))

cluster_7 = Cluster(num=multiplication_8, B=Slider(0.22, range=0..1))  # -> num_3, R
rectangle = Rectangle(Plane=pln_10, XSize=cluster_7.num_3, YSize=cluster_7.R, Radius=1000)  # -> Rectangle, Length

crv_3 = Curve(rectangle.Rectangle)

filter_2 = StreamFilter(Gate=int_2, Stream0=crv_3, Stream1=crv, Stream2=crv_2)
col_3 = Colour(col_2)
list = ValueList({"Circle": "1_circle_", "Triangular": "2_triangular_", "Line": "3_line_"}, selected="Line")
digit_scroller = DigitScroller(Scroller_Digits=12, Scroller_Prefix="Fragment B", Scroller_Radix=11, Scroller_Value=17)
background_2 = ColourSwatch(SwatchColor=RGB(0, 0, 0))
panel_5 = Panel("""1_circle_
2_triangular_
3_line_""")
panel_6 = Panel("""0
1
2""")
outline = Outline(Color=background_2, Width=Slider(2, range=0..10))
concat_2 = Concatenate(FragmentA=list, FragmentB=digit_scroller)
keysearch_2 = KeyValueSearch(Keys=panel_5, Values=panel_6, Search=list)
filter_3 = StreamFilter(Gate=keysearch_2)
save = Save(Folder="C:\Users\Филипп\Desktop\Generative_patters\imgs\sketch2", Filename=txt, Tiff=False)  # -> SquidInstr, Path; disabled
rec_2 = Rectangle(rec)

sort_2 = SortList(Keys=num_17, ValuesA=filter_2, ValuesB=col_3)  # -> Keys, ValuesA, ValuesB

crv_4 = Curve(sort_2.ValuesA)
draw = Draw(Curve=crv_4, Accuracy=-1, Fill=sort_2.ValuesB)  # -> SquidInstr, Curve
merge_2 = Merge(Data1=flatten(clear), Data2=flatten(draw.SquidInstr), Data3=flatten(save.SquidInstr))
squid = Squid(BitmapR=rec_2, SquidInstr=merge_2, PPU=1, AA=True, autohide=False)

# ==== cluster Cluster
num = ClusterInput()
num_2 = Number(num)
B = ClusterInput()
multiplication = Multiplication(A=num_2, B=B)
R = ClusterOutput(multiplication)
num_3 = ClusterOutput(num_2)

# ==== cluster Rotate45
pln = ClusterInput()
pln_2 = Plane(pln)
rotate = Rotate(Geometry=pln_2, Angle=0.7853981634, Plane=pln_2)  # -> Geometry, Transform
pln_3 = Plane(rotate.Geometry)
pln_4 = ClusterOutput(pln_3)

# ==== cluster Cluster_2
base = ClusterInput()
delta = ClusterInput()
subtraction = Subtraction(A=base, B=delta)
addition = Addition(A=base, B=delta)
dom = ConstructDomain(DomainStart=subtraction, DomainEnd=addition)
I = ClusterOutput(dom)

# ==== cluster DomainToColorsHSV
I = ClusterInput()
dedomain = DeconstructDomain(Domain=I)  # -> Start, End
avr = Average(Input=[dedomain.Start, dedomain.End])
merge = Merge(Data1=dedomain.Start, Data2=avr, Data3=dedomain.End)
eval = Evaluate(F="if(x>1,x-Floor(x),if(x<0,x-Floor(x),x))", x=merge)
hsl = ColourHSL(Alpha=1, Hue=eval, Saturation=1, Luminance=0.5)
C = ClusterOutput(hsl)

# ==== cluster MultChosenByRandom
num = ClusterInput()
S = ClusterInput()
R = ClusterInput()
bool = ClusterInput()
bool_2 = Boolean(bool)
num_2 = Number(num)
not = GateNot(A=bool_2)
ma = MassAddition(Input=not)  # -> Result, PartialResults
ma_2 = MassAddition(Input=bool_2)  # -> Result, PartialResults
random = Random(Range=R, Number=ma_2.Result, Seed=S)
repeat = RepeatData(Data=1, Length=ma.Result)
weave = Weave(Pattern=bool_2, Stream0=repeat, Stream1=random, NullGaps=False)
multiplication = Multiplication(A=num_2, B=weave)
num_3 = Number(multiplication)
W = ClusterOutput(weave)
num_4 = ClusterOutput(num_3)

# ==== cluster Cluster_3
num = ClusterInput()
num_2 = Number(num)
neg = Negative(Value=num_2)
dom = ConstructDomain(DomainStart=neg, DomainEnd=num_2)
I = ClusterOutput(dom)

# ==== cluster Cluster_4
T = ClusterInput()
B = ClusterInput()

len = TextLength(Text=T)
multiplication = Multiplication(A=len, B=B)

int = Integer(60)
mod = Modulus(A=multiplication, B=int)
remap = RemapNumbers(Value=mod, Source=int, Target=Domain(0, 1))  # -> Mapped, Clipped
num = Number(remap.Mapped)

num_2 = ClusterOutput(num)

# ==== cluster Cluster_5
range = Range(Domain=Domain(0, 6.283185307), Steps=4)
B = ClusterInput()
jitter = Jitter(List=range, Jitter=1, Seed=2)  # -> Values, Indices
long = LongestList(ListA=jitter.Values, ListB=B, PaddingMode=4)  # -> ListA, ListB
prot = RotatePlane(Plane=B, Angle=long.ListA)
P = ClusterOutput(prot)

# ==== cluster Cluster_6
rec = ClusterInput()
seed = ClusterInput()
rec_2 = Rectangle(rec)
drec = DeconstuctRectangle(Rectangle=rec_2)  # -> BasePlane, XInterval, YInterval
int = Integer(seed)
int_2 = Integer(150)
dedomain = DeconstructDomain(Domain=drec.YInterval)  # -> Start, End
dedomain_2 = DeconstructDomain(Domain=drec.XInterval)  # -> Start, End
addition = Addition(A=int, B=1)
avr = Average(Input=[dedomain.Start, dedomain.End])
V = ClusterInput()
subtraction = Subtraction(A=dedomain_2.End, B=int_2)
addition_2 = Addition(A=dedomain_2.Start, B=int_2)
random = Random(Range="800 to 1600", Number=1, Seed=int)
dom = ConstructDomain(DomainStart=addition_2, DomainEnd=subtraction)
remap = RemapNumbers(Value=V, Source=Domain(0, 1), Target=Domain(-0.7, 0))  # -> Mapped, Clipped
remap_2 = RemapNumbers(Value=V, Source=Domain(0, 1), Target=Domain(-0.7, 0))  # -> Mapped, Clipped
addition_3 = Addition(A=avr, B=random)
random_2 = Random(Range=dom, Number=1, Seed=addition)
pt = ConstructPoint(XCoordinate=random_2, YCoordinate=avr, ZCoordinate=0)
pt_2 = ConstructPoint(XCoordinate=random_2, YCoordinate=addition_3, ZCoordinate=0)
rotate = Rotate(Geometry=pt, Angle=remap.Clipped, Plane=pt_2)  # -> Geometry, Transform
dsh = ClusterOutput(remap_2.Clipped)
G = ClusterOutput(rotate.Geometry)
